# Grasshopper definition 批量生成坡屋顶平房3.gh (Grasshopper 1.0.7)
# plug-ins: Bifocals, LunchBox

# ---- group: 分步运算器（对自己和电脑都好一点）
# 3、单击运行
trigger = Trigger(Interval=100, TimerInterval=100, Target=data_recorder)  # disabled
# 2、右键更改Record Limit
panel = Panel("1")
data_recorder = DataRecorder(panel, DataLimit=73, RecordData=False)
mass_addition = MassAddition(Input=data_recorder)  # -> Result, PartialResults

# ----
# 1、set multiple breps
brep = Brep([<brep referenced from the Rhino model> x73])
# 本电池组可以自行判断屋脊方向
# 运算前请到电池图结尾处确认，新建的两个图层名称与现有的不重复
# 如有少量体块重合请手动删除
# 如最后一组体块未自动bake,请到结尾红色框内手动bake
# 运算结束后请勿保存
list_length = ListLength(List=brep)
# 如不慎保存，请点击data recorder中的X
panel_2 = Panel(list_length)
addition = Addition(A=mass_addition.Result, B="-1")
list_item = ListItem(List=brep, Index=addition, Wrap=True)

# ---- group: 自动bake
smaller_than = SmallerThan(FirstNumber=mass_addition.Result, SecondNumber=panel_2)  # -> SmallerThan, OrEqualTo
data_dam = DataDam(DataDataA=smaller_than.SmallerThan, BufferDelay=2500000, BufferMode=2)

# ---- group: 取底面坐标
brep_wireframe = BrepWireframe(Brep=list_item, Density=-1)
extremes = Extremes(Curve=brep_wireframe, Plane=PlaneXY(0, 0, 0))  # -> Highest, Lowest
cull_duplicates = CullDuplicates(Points=[extremes.Lowest, extremes.Highest], Tolerance=0.1, CullMode=3)  # -> Points, Indices, Valence
list_length_2 = ListLength(List=cull_duplicates.Points)
equality = Equality(FirstNumber="8", SecondNumber=list_length_2)  # -> Equality, Inequality
cull_pattern = CullPattern(List=cull_duplicates.Points, CullPattern=equality.Equality)
deconstruct = Deconstruct(Point=cull_pattern)  # -> XComponent, YComponent, ZComponent
equality_2 = Equality(FirstNumber=deconstruct.ZComponent, SecondNumber="0")  # -> Equality, Inequality
cull_pattern_2 = CullPattern(List=cull_pattern, CullPattern=equality_2.Equality)

# ----
# 排除非六面体
cull_pattern_3 = CullPattern(List=list_item, CullPattern=flatten(equality.Equality))
屋檐下沿高度 = Panel("0,0,2400")
move = Move(Geometry=cull_pattern_2, Motion=屋檐下沿高度)  # -> Geometry, Transform
# 屋顶扫略断面线连线
list_item_2 = ListItem(List=move.Geometry, Index=0, Wrap=True)  # -> Item, Item1, Item2, Item3
point_list = PointList(Points=move.Geometry, Size="2000")
line = Line(StartPoint=list_item_2.Item1, EndPoint=list_item_2.Item2)
line_2 = Line(StartPoint=list_item_2.Item2, EndPoint=list_item_2.Item3)
line_3 = Line(StartPoint=list_item_2.Item, EndPoint=list_item_2.Item3)
line_4 = Line(StartPoint=list_item_2.Item, EndPoint=list_item_2.Item1)
curve_middle = CurveMiddle(Curve=line_3)
curve_middle_2 = CurveMiddle(Curve=line_2)
curve_middle_3 = CurveMiddle(Curve=line)
curve_middle_4 = CurveMiddle(Curve=line_4)
屋脊比屋檐高多少 = Panel("0,0,1800")
move_2 = Move(Geometry=curve_middle_3, Motion="0,0,1800")  # -> Geometry, Transform
move_3 = Move(Geometry=curve_middle_4, Motion=屋脊比屋檐高多少)  # -> Geometry, Transform
move_4 = Move(Geometry=curve_middle, Motion="0,0,1800")  # -> Geometry, Transform
move_5 = Move(Geometry=curve_middle_2, Motion="0,0,1800")  # -> Geometry, Transform
line_5 = Line(StartPoint=list_item_2.Item, EndPoint=move_3.Geometry)
line_6 = Line(StartPoint=move_3.Geometry, EndPoint=list_item_2.Item1)
line_7 = Line(StartPoint=list_item_2.Item1, EndPoint=move_2.Geometry)
line_8 = Line(StartPoint=move_2.Geometry, EndPoint=list_item_2.Item2)
line_9 = Line(StartPoint=move_4.Geometry, EndPoint=list_item_2.Item3)
line_10 = Line(StartPoint=list_item_2.Item3, EndPoint=move_5.Geometry)
line_11 = Line(StartPoint=list_item_2.Item, EndPoint=move_4.Geometry)

# ---- group: 判断屋脊朝向
line_12 = Line(StartPoint=move_2.Geometry, EndPoint=move_4.Geometry)
line_13 = Line(StartPoint=move_3.Geometry, EndPoint=move_5.Geometry)
length = Length(Curve=line_12)
length_2 = Length(Curve=line_13)
larger_than = LargerThan(FirstNumber=length_2, SecondNumber=length)  # -> LargerThan, OrEqualTo

# ----
line_14 = Line(StartPoint=move_5.Geometry, EndPoint=list_item_2.Item2)
join_curves = JoinCurves(Curves=[line_7, line_8], Preserve=False)
join_curves_2 = JoinCurves(Curves=[line_5, line_6], Preserve=False)
curve_curve = CurveCurve(CurveA=line_13, CurveB=line_12)  # -> Points, ParamsA, ParamsB
join_curves_3 = JoinCurves(Curves=[line_10, line_14], Preserve=False)
join_curves_4 = JoinCurves(Curves=[line_11, line_9], Preserve=False)
cull_pattern_4 = CullPattern(List=join_curves_2, CullPattern=larger_than.OrEqualTo)
cull_pattern_5 = CullPattern(List=join_curves, CullPattern=invert(larger_than.OrEqualTo))
cull_pattern_6 = CullPattern(List=curve_curve.Points, CullPattern=invert(larger_than.OrEqualTo))  # -> flatten(List)
cull_pattern_7 = CullPattern(List=join_curves_4, CullPattern=invert(larger_than.OrEqualTo))
cull_pattern_8 = CullPattern(List=join_curves_3, CullPattern=larger_than.OrEqualTo)
cull_pattern_9 = CullPattern(List=curve_curve.Points, CullPattern=larger_than.OrEqualTo)  # -> flatten(List)
cull_pattern_10 = CullPattern(List=line_12, CullPattern=invert(larger_than.OrEqualTo))
cull_pattern_11 = CullPattern(List=line_13, CullPattern=larger_than.OrEqualTo)
loft = Loft(
    Curves=[cull_pattern_4, cull_pattern_11, cull_pattern_8],
    Options={Adjust=False, Closed=False, LoftEnds=0, LoftSimp=0, LoftType=0, Rebuild=10, Refit=0.01})
loft_2 = Loft(
    Curves=[cull_pattern_5, cull_pattern_10, cull_pattern_7],
    Options={Adjust=False, Closed=False, LoftEnds=0, LoftSimp=0, LoftType=0, Rebuild=10, Refit=0.01})
brep_join = BrepJoin(Breps=loft)  # -> flatten(Breps), Closed
brep_join_2 = BrepJoin(Breps=loft_2)  # -> flatten(Breps), Closed
scale = Scale(Geometry=brep_join.Breps, Center=cull_pattern_9, Factor=Slider(1.1, range=0..10))  # -> Geometry, Transform
scale_2 = Scale(Geometry=brep_join_2.Breps, Center=cull_pattern_6, Factor=Slider(1.1, range=0..10))  # -> Geometry, Transform
extrude = Extrude(Base=scale.Geometry, Direction="0,0,15000")
extrude_2 = Extrude(Base=scale_2.Geometry, Direction="0,0,15000")

extrude_3 = Extrude(Base=[scale_2.Geometry, scale.Geometry], Direction="0,0,150")
solid_difference = SolidDifference(BrepsA=cull_pattern_3, BrepsB=flatten([extrude, extrude_2]))

object_bake = ObjectBake(
    BakeToggle=data_dam,
    GeometryObjects=solid_difference,
    Layer="平房墙体",
    ObjectName="GH_Obj",
    ObjectColor=RGB(255, 255, 255),
    LayerColor=RGB(255, 255, 255))
object_bake_2 = ObjectBake(
    BakeToggle=data_dam,
    GeometryObjects=extrude_3,
    Layer="平房屋顶",
    ObjectName="GH_Obj",
    ObjectColor=RGB(255, 255, 255),
    LayerColor=RGB(255, 255, 255))
